# Grasshopper definition tile_layout_calculator_v1.gh.gh (Grasshopper 1.0.8)

# ----
# タイル横枚数
# タイル縦枚数
number_slider = Slider(37, range=0..100)

# ----
# タイル幅
# タイル高さ
number_slider_2 = Slider(60, range=0..100)
number_slider_3 = Slider(250, range=0..1000)

# ----
# 目地幅
number_slider_4 = Slider(10, range=0..100)

pt = Point(Point(1743.029833, -380.2093503, 0))

division = Division(A=number_slider_4, B="2")

xy = XYPlane(Origin=Point(0, 0, 0))
addition = Addition(A=number_slider_4, B=number_slider_3)
rectangle = Rectangle(Plane=xy, XSize=number_slider_3, YSize=number_slider_2, Radius=0)  # -> Rectangle, Length
area = Area(Geometry=rectangle.Rectangle)  # -> Area, Centroid
addition_2 = Addition(A=number_slider_2, B=number_slider_4)
recgrid = Rectangular(Plane=pt, SizeX=addition, SizeY=addition_2, ExtentX=Slider(20, range=0..100), ExtentY=number_slider)  # -> Cells, Points
area_2 = Area(Geometry=recgrid.Cells)  # -> Area, Centroid
X = UnitX(Factor=division)
Y = UnitY(Factor=division)
move = Move(Geometry=area_2.Centroid, Motion=X)  # -> Geometry, Transform
move_2 = Move(Geometry=move.Geometry, Motion=Y)  # -> flatten(Geometry), Transform
orient = Orient(Geometry=rectangle.Rectangle, Source=area.Centroid, Target=move_2.Geometry)  # -> Geometry, Transform

# ----
# タイル総数表示
lng = ListLength(List=orient.Geometry)
# 自由にお使いいただけますが、問題が起きても一切の責任を負いません。
# 
# このファイルは私の著作物です、ライセンスはMITに従います。
# Feel free to use this file at your own risk. The author is not responsible for any issues or damages.
# This work is licensed under the MIT License.
# 
# (C) 2026 YUKI MATSUDA / Architectural Solutions Design Office
panel = Panel("150")
pt_2 = Point(Point(7928.658969, -361.5832341, 0))
tag = TextTag3D(Location=pt_2, Text=lng, Size=panel, Justification=7)

# ----
# タイルナンバー
number_slider_5 = Slider(1, range=0..1)
series = Series(Start=number_slider_5, Step=1, Count=lng)
tag_2 = TextTag3D(Location=move_2.Geometry, Text=series, Size="20", Justification=7)
